% Simulink data dictionary S32K39_CodeGen.sldd
% references S32K3_Adc_Typedefs.sldd

AdcReadData = Simulink.Signal(StorageClass="ExportedGlobal", DataType="uint16")
ClearFault = Simulink.Signal(StorageClass="ExportedGlobal", DataType="boolean")
FaultCode = Simulink.Signal(StorageClass="ExportedGlobal", DataType="int16")
FaultStatus = Simulink.Signal(StorageClass="ExportedGlobal", DataType="boolean")
RShunt = 0.5
ShuntCurrent = Simulink.Signal(StorageClass="ExportedGlobal", DataType="single")
ShuntVoltage = Simulink.Signal(StorageClass="ExportedGlobal", DataType="single")
Sig = Simulink.Signal()