% Simulink data dictionary S32K39_CodeGen_Solution.sldd
% references S32K3_Adc_Typedefs.sldd

ClearFault = Simulink.Signal(StorageClass="ExportedGlobal", DataType="boolean")
FaultStatus = Simulink.Signal(StorageClass="ExportedGlobal", DataType="boolean")
FaultCode = Simulink.Signal(StorageClass="ExportedGlobal", DataType="int16")
AdcReadData = Simulink.Signal(StorageClass="ExportedGlobal", DataType="uint16")
Sig = Simulink.Signal()
ShuntVoltage = Simulink.Signal(StorageClass="ExportedGlobal", DataType="single")
ShuntCurrent = Simulink.Signal(StorageClass="ExportedGlobal", DataType="single")
RShunt = 0.5